test file "compare_agents"

suite "compare_agents/compare_agents__simulate_nmpc_agent"

  case "compare_agents_Harness1" [baseline]
    description: Test generated for the component 'compare_agents/compare_agents__simulate_nmpc_agent'.
    model compare_agents, harness compare_agents_Harness1 (for compare_agents/compare_agents__simulate_nmpc_agent)

suite "compare_agents/compare_agents__simulate_nrhdg_agent"

  case "compare_agents_Harness2" [baseline]
    description: Test generated for the component 'compare_agents/compare_agents__simulate_nrhdg_agent'.
    model compare_agents, harness compare_agents_Harness2 (for compare_agents/compare_agents__simulate_nrhdg_agent)